# Dynamo graph DShapeFinishing  - Создать DS по Face (для имени DS выбрать в ревите пример).dyn "DShapeFinishing - Создать DS по Face (для имени DS выбрать в ревите пример)" (Dynamo 2.3.0.5885)

# group: ЭЛЕМЕНТЫ УПРАВЛЕНИЯ
# note: ПЕРЕМЕННЫЕ ЗНАЧЕНИЯ
# note: ЭЛЕМЕНТЫ УПРАВЛЕНИЯ

# group: ПОЛУЧАЕМ ДАННЫЕ
# note: ПОЛУЧАЕМ ДАННЫЕ ИЗ РЕВИТ и других источников

# group: ПРОВЕРОЧНЫЕ НОДЫ
# note: ПРОВЕРОЧНЫЕ НОДЫ

# group: КЛЮЧЕВЫЕ МОМЕНТЫ РАБОТЫ 1
# note: КОНСОЛИДАЦИЯ И СЛОЖНЫЕ ОБРАБОТКИ

# group: ИСПОЛНИТЕЛЬНЫЕ НОДЫ (фильтрование, подбор, списки и т.д.)
# note: ИСПОЛНИТЕЛЬНЫЕ НОДЫ

# group: ПЕРЕДАЁМ ИНФОРМАЦИЮ
# note: ПЕРЕДАЁМ ИНФОРМАЦИЮ В РЕВИТ
# note: ПЕРЕДАЁМ ИНФОРМАЦИЮ ЕЩЁ КУДА-ТО

# group: ЗАПАСНЫЕ ВАРИАНТЫ, ДОПОЛНИТЕЛЬНЫЕ ОПЦИИ
# note: ЗАПАСНЫЕ
# note: ДОПОЛНИТЕЛЬНЫЕ. Градации серово по важности, темнее - важнее

# group: ПРИМЕЧАНИЯ ПО ЦВЕТОВОЙ ГРУППИРОВКЕ
# note: GUIDELINES

# group: КЛЮЧЕВЫЕ МОМЕНТЫ РАБОТЫ 2
# note: УСЛОЖНЕННЫЕ КОНСТРУКЦИИ
# note: УСЛОЖНЕНЫЕ КОНСТРУКЦИИ

# group: Python ноды
# note: Python

# group: ЭЛЕМЕНТЫ УПРАВЛЕНИЯ 2 УРОВЕНЬ
# note: ЭЛЕМЕНТЫ УПРАВЛЕНИЯ
# note: ПЕРЕМЕННЫЕ ЗНАЧЕНИЯ

# group: Запуск питона из внешнего файла
# note: Py - files

parameters = Element.Parameters()  # unwired: element
geometry = Element.Geometry()  # unwired: element
setParameterByName = Element.SetParameterByName()  # unwired: element, parameterName, value
# note: ВСЁ ОСТАЛЬНОЕ
getParameterValueByName = Element.GetParameterValueByName()  # unwired: element, parameterName

# group: Parameters name from language
parameters_name_from_language = Python()  # graph input; frozen
# ---------- parameters_name_from_language.python (18 lines) ----------
import clr
clr.AddReference('RevitServices')
import RevitServices
from RevitServices.Persistence import DocumentManager

uiapp = DocumentManager.Instance.CurrentUIApplication
app = uiapp.Application
lng = app.Language
rus = ["Тип","Имя семейства","Имя типа"]
enu = ["Type","Family name","Type name"]
out = []
if str(lng) == "Russian":
	out = rus
else:
	out = enu
#English_USA
#Russian
OUT = out
# ----------------------------------------

# group: элементы внутри групп
members = Python()  # "Group.Members"; frozen; unwired: IN[0]
# ---------- members.python (19 lines) ----------
import clr
clr.AddReference('RevitAPI')
from Autodesk.Revit.DB import *

clr.AddReference("RevitNodes")
import Revit
clr.ImportExtensions(Revit.Elements)

groups = UnwrapElement(IN[0])
elementlist = list()
for item in groups:
	try:
		memberlist = list()
		for member in item.GetMemberIds():
			memberlist.append(item.Document.GetElement(member))
		elementlist.append(memberlist)
	except:
		elementlist.append(list())
OUT = elementlist
# ----------------------------------------

путь_к_файлу_python = Filename(".\N.Отделка помещений_сбор элементов вокруг_1.7.py")  # frozen
find_file_and_import_it = Python(IN[0]=путь_к_файлу_python)  # unwired: IN[1]
# ---------- find_file_and_import_it.python (11 lines) ----------
import sys
sys.path.append('C:\Program Files (x86)\IronPython 2.7\Lib')
import codecs

try:
	filePath = IN[0]
	with codecs.open(filePath, 'rb', "utf-8") as inf:
		lines = inf.readlines()
	OUT = ''.join(lines)
except:
	OUT = "No file"
# ----------------------------------------
python_script_from_string = PythonStringNode(script=find_file_and_import_it)  # unwired: IN[0]
categories = Categories()  # nothing selected; frozen
all_elements_of_category = ElementsOfCategory(Category=categories)
regenerate = Python()  # frozen; unwired: IN[0]
# ---------- regenerate.python (26 lines) ----------
import clr

# Import DocumentManager and TransactionManager
clr.AddReference("RevitServices")
import RevitServices
from RevitServices.Persistence import DocumentManager


# Import RevitAPI
clr.AddReference("RevitAPI")
import Autodesk
from Autodesk.Revit.DB import *

doc = DocumentManager.Instance.CurrentDBDocument


#The inputs to this node will be stored as a list in the IN variable.
list = IN[0]


if list:
	doc.Regenerate()
	out = "Regeneration complete"
else:
	out = "fail"
OUT = out
# ----------------------------------------
members_2 = Python()  # "Object.Members"; frozen; unwired: IN[0]
# ---------- members_2.python (14 lines) ----------
import clr

items = IN[0]
elementlist = list()

try:
	clr.AddReference('RevitAPI')
	from Autodesk.Revit.DB import *
	for item in items:
		elementlist.append(dir(UnwrapElement(item)))
except:
	for item in items:
		elementlist.append(dir(item))
OUT = elementlist
# ----------------------------------------
filteredElementCollector = Python()  # frozen; unwired: IN[0]
# ---------- filteredElementCollector.python (29 lines) ----------
if IN[1]:
	import clr
	
	# Import DocumentManager and TransactionManager
	clr.AddReference("RevitServices")
	import RevitServices
	from RevitServices.Persistence import DocumentManager
	
	
	# Import RevitAPI
	clr.AddReference("RevitAPI")
	import Autodesk
	from Autodesk.Revit.DB import *
	
	doc = DocumentManager.Instance.CurrentDBDocument
	uiapp = DocumentManager.Instance.CurrentUIApplication
	app = uiapp.Application
	
	from System.Collections.Generic import *
	
	
	#The inputs to this node will be stored as a list in the IN variable.
	dataEnteringNode = IN
	collector = FilteredElementCollector(doc)
	elements = collector.OfCategory(BuiltInCategory.OST_Views).ToElements()
	
	OUT = sheetInstances
else:
	OUT = "скрипт не выполнен"
# ----------------------------------------
shablon_python_shablon = Python()  # frozen; unwired: IN[0]
# ---------- shablon_python_shablon.python (76 lines) ----------
# -*- coding: utf-8 -*- 
#-----------------------Импоорт библиотек----------------------
import clr
clr.AddReference('RevitAPI')
import Autodesk
from Autodesk.Revit.DB import *

clr.AddReference("RevitNodes") 
import Revit
from Revit.Elements import *

clr.ImportExtensions(Revit.Elements) #ToDSType не работает без
clr.ImportExtensions(Revit.GeometryConversion) #ToXyz не работает без

clr.AddReference("RevitServices")
import RevitServices
from RevitServices.Persistence import DocumentManager
from RevitServices.Transactions import TransactionManager

clr.AddReference('ProtoGeometry')
from Autodesk.DesignScript.Geometry import *

#-----------------------ИМПОРТ БИБЛИОТЕК----------------------
"""-"""
#-----------------------ФУНКЦИИ----------------------

def __x__(x):
	x="x"
	return x
	
#-----------------------ФУНКЦИИ----------------------
"""-"""
#-----------------------АПИ ПАРАМЕТРЫ----------------------

doc = DocumentManager.Instance.CurrentDBDocument
#link_doc = UnwrapElement(IN[1])
#uiapp = DocumentManager.Instance.CurrentUIApplication
#app = uiapp.Application
#version = app.VersionNumber
#options = Autodesk.Revit.DB.SpatialElementBoundaryOptions()
calculator = SpatialElementGeometryCalculator(doc)

g_id_list = []
g_id_list.append(ElementId(group))

bxList = List[ElementId](g_id_list) #АЙ ЛИСТ КОЛЕКТИОН
move = Transform.CreateTranslation(-wall.Orientation*2) #смещение
cl.CreateTransformed(move)

#-----------------------АПИ ПАРАМЕТРЫ----------------------
"""-"""
#-----------------------РАБОЧИЕ ПАРАМЕТРЫ----------------------

rooms = UnwrapElement(IN[0])

#-----------------------РАБОЧИЕ ПАРАМЕТРЫ----------------------	
"""-"""
#-----------------------ТЕСТОВЫЕ ПАРАМЕТРЫ----------------------

test = []

#-----------------------ТЕСТОВЫЕ ПАРАМЕТРЫ----------------------
"""-"""
#-----------------------НАЧАЛО СКРИПТА----------------------

x = 0
if rooms == None:
	rooms = [0,0]

for room in rooms:
	x=__x__(x)+__x__(x)
#TransactionManager.Instance.EnsureInTransaction(doc)
#TransactionManager.Instance.TransactionTaskDone()
#-----------------------КОНЕЦ СКРИПТА----------------------

OUT = x
# ----------------------------------------
создать_ds = BoolSelector(true)  # graph input
select_faces = SelectFaces()  # 2 picked in the model; frozen
byJoinedSurfaces = PolySurface.ByJoinedSurfaces(surfaces=select_faces)
boundingBox = Geometry.BoundingBox(geometry=byJoinedSurfaces)
подрезка_снизу_мм = StringInput("200")  # graph input

# group: Подрезка снизу
minPoint = BoundingBox.MinPoint(boundingBox=boundingBox)
Z = Point.Z(point=minPoint)
toNumber = String.ToNumber(str=подрезка_снизу_мм)
add = Z + toNumber
byOrigin = CoordinateSystem.ByOrigin(z=add)
XYPlane = CoordinateSystem.XYPlane(coordinateSystem=byOrigin)
split = Geometry.Split(geometry=select_faces, other=XYPlane)
code_block = CodeBlock { 0; }
getItemAtIndex = List.GetItemAtIndex(list=split@L2, index=code_block)

подрезка_сверху_мм = StringInput("200")  # graph input

# group: Подрезка сверху, мм
maxPoint = BoundingBox.MaxPoint(boundingBox=boundingBox)
Z_2 = Point.Z(point=maxPoint)
toNumber_2 = String.ToNumber(str=подрезка_сверху_мм)
sub = Z_2 - toNumber_2
byOrigin_2 = CoordinateSystem.ByOrigin(z=sub)
XYPlane_2 = CoordinateSystem.XYPlane(coordinateSystem=byOrigin_2)
split_2 = Geometry.Split(geometry=getItemAtIndex, other=XYPlane_2)
code_block_2 = CodeBlock { 1; }
getItemAtIndex_2 = List.GetItemAtIndex(list=split_2@L2, index=code_block_2)

code_block_3 = CodeBlock { null; }
if_ = Python(IN[0]=создать_ds, IN[1]=getItemAtIndex_2, IN[2]=code_block_3)
# ---------- if_.python (4 lines) ----------
if IN[0]:
	OUT = IN[1]
else:
	OUT = IN[2]
# ----------------------------------------
select_model_element = DSModelElementSelection()  # 1 picked in the model

# group: Создаём ДиректШейп и применяем материал
категория_для_добавления_ds = Categories("OST_Walls")  # graph input
getMaterials = Element.GetMaterials(element=select_model_element)
code_block_4 = CodeBlock(material=getMaterials) { material[0]; }
code_block_5 = CodeBlock(name=select_model_element) { name; }
name = Element.Name(element=code_block_5)
byGeometry = DirectShape.ByGeometry(geometry=if_@L1, category=категория_для_добавления_ds, material=code_block_4, name=name)  # frozen
имя_материала = StringInput("ADSK_Бетон_Железобетон")  # graph input
byName = Material.ByName(name=имя_материала)

color_palette = ColorPalette({R: 0, G: 250, B: 154, A: 255})
byGeometryColor = Modifiers.GeometryColor.ByGeometryColor(geometry=if_, color=color_palette)
color_palette_2 = ColorPalette({R: 238, G: 130, B: 238, A: 255})
byGeometryColor_2 = Modifiers.GeometryColor.ByGeometryColor(geometry=select_faces, color=color_palette_2)
pixels = Image.Pixels()  # unwired: image, xSamples, ySamples
fromPixels = Image.FromPixels()  # unwired: colors, width, height
fromPixels_2 = Image.FromPixels()  # unwired: colors
byColorsAndParameters = ColorRange.ByColorsAndParameters()  # unwired: colors, parameters
select_face = DSFaceSelection()  # 1 picked in the model; graph input
file_path = Filename("D:\data\BIM\Screenshot_3.png")
file_from_path = FileObject(path=file_path)
readFromFile = Image.ReadFromFile(file=file_from_path)
code_block_6 = CodeBlock { 4; }
dimensions = Image.Dimensions(image=readFromFile)
code_block_7 = CodeBlock(a=code_block_6, x=dimensions.width, y=dimensions.height) { a; x/a; y/a; }
pixels_2 = Image.Pixels(image=readFromFile, xSamples=code_block_7.out1, ySamples=code_block_7.out2)
bySurfaceColors = Modifiers.GeometryColor.BySurfaceColors(surface=select_face, colors=pixels_2)
